# Grasshopper definition E01_0.2.0_SimplePoint&Box.gh (Grasshopper 0.9.56)
# plug-ins: Embryo

# E01. Introduction
# 
# Embryo uses 3 of the 4 quadrants on the canvas.
# 
# The 'Parent' definition is located in the usual quadrant on the canvas and contains the Embryo main component.
# 
# The 'Child' generated network is in the top-right quadrant.
# The 'Ingredients' that are used (the components) by Embryo when the new graph is formed are located in the bottom-left quadrant.
# The component types that are used are placed here. More of the same type increases the likelyhood of selection (such as with the points here).
# You can enable/disable to include/exclude in your graph generation
pt = ConstructPoint(XCoordinate=0, YCoordinate=0, ZCoordinate=0)
box = Box2Pt(Plane=PlaneXY(0, 0, 0))
pt_2 = ConstructPoint(XCoordinate=0, YCoordinate=0, ZCoordinate=0)

# ----
# Set to True
toggle = BooleanToggle(False)

# ----
# Sliders & Component numbers
sliders = Slider(6, range=0..100)
components = Slider(35, range=0..100)

# ----
# Change Random Seed to Explore
random_seed = Slider(26, range=0..100)

# ----
# The generated graph is sorted in terms of dependency.
# 
# The parameters always have rank 0 and therefore are located on the far left hand side.
# 
# In a technical sense, the directed acyclic graph (DAG) that is generated is topologically sorted to show a dependency structure.
# This is the main Embryo component that generates the new definitions.
# 
# Embryo has two separate (at present random) seeds for generating the parameters and the graph components/topology. In this example they are both controlled by one slider
embryo = Embryo(Reset=toggle, Sliders=sliders, Components=components, MetricSeed=random_seed, TopologySeed=random_seed, Settings=null)  # -> Iterations, Components
